# Grasshopper definition ConstantLoad_v01.gh (Grasshopper 0.9.76)
# plug-ins: DynamicMass, Starling

# ---- group: Input curves
# Form-finding with weak springs.
crv = Curve([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])

# ----
line = Line(crv)

# ---- group: Find nodes of valency <3
pmconnvert = PmConnectedVertices(Polylines=line)
lng = ListLength(List=pmconnvert)  # -> flatten(Length)
smaller = SmallerThan(FirstNumber=lng, SecondNumber="3")  # -> SmallerThan, OrEqualTo

# ----
pmcomp = PmDecompose(Polylines=line)  # -> Vertices, Faces
dispatch = Dispatch(List=flatten(pmcomp.Vertices), DispatchPattern=smaller.SmallerThan)  # -> ListA, ListB

# ---- group: Supports
msphereex = MeshSphereEx(Base=dispatch.ListA, Radius=Slider(0.1, range=0..0.1), Count=5)
preview = CustomPreview(Geometry=msphereex, Shader=ColourSwatch(SwatchColor=RGB(0, 0, 0)))

# ---- group: Weak spring
number_slider = Slider(20, range=0..100)

# ----
# Tweak graviational constant >>
number_slider_2 = Slider(0.01, range=0..0.01)
# Reset like Kangaroo
# Reset like Kangaroo
# Enable timer
toggle = BooleanToggle(False)
# Enable timer
timer = Timer(TimerInterval=20, Target=dynamicmass)  # disabled
dynamicmass = DynamicMass(
    Nodes=pmcomp.Vertices,
    Springs=line,
    Supports=dispatch.ListA,
    Stiffnesses=number_slider,
    NatLengths=0,
    MassDensity=1,
    MassType="0",
    Damping=Slider(0.95, range=0..1),
    Gravity=Slider(5, range=-10..20),
    TimeStep=number_slider_2,
    Reset=toggle)  # -> Nodes, Valence, Masses, Bars, Forces, Iterations, Neighbours, Meshes

# ---- group: Area approximation used for area load
mesh = Mesh(dynamicmass.Meshes)

# ----
preview_2 = CustomPreview(Geometry=mesh, Shader=ColourSwatch(SwatchColor=RGBA(27, 169, 109, 82)))

# ---- group: Show thrust network
preview_3 = CustomPreview(Geometry=dynamicmass.Bars, Shader=ColourSwatch(SwatchColor=RGB(64, 64, 64)))

# ----
forces_n = Panel(dynamicmass.Forces)
