# Grasshopper definition DynamicAreaLoad_v04.gh (Grasshopper 0.9.76)
# plug-ins: MeshEdit Components, DynamicMass, Starling

# ---- group: Input curves
# 1. Form-finding with weak springs.
crv = Curve([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])

# ---- group: Form-found nodes, supports & bars
# 2. Check tension-only result with stiff springs.
pt = Point([Point(-3.828283787, 5.745425224, 2), Point(-1.099136472, 6.933872312, 3.105804808), Point(-2.977893353, 10.17921448, 2), Point(-0.6360197793, 9.047835694, 3.118385009), Point(-2.591150045, 1.36666584, 2), Point(1.166956295, 6.008521344, 3.702934189)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])
pt_2 = Point([Point(-3.828283787, 5.745425224, 2), Point(-2.977893353, 10.17921448, 2), Point(-2.591150045, 1.36666584, 2), Point(0.2813107371, -2.454623222, 2), Point(1.703722954, 14.7683754, 2), Point(5.521384716, 7.866375923, 0)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])
crv_2 = Curve([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])

# ---- group: Final area based mass values
num = Number([0, 8.270017438, 0, 8.736893596, 0, 5.687620388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])

# ----
line = Line(crv)

# ---- group: (smaller time step to avoid blow up)
number_slider = Slider(1e-05, range=0..1e-05)

# ----
len = Length(Curve=crv_2)

# ---- group: Stiffer springs
number_slider_2 = Slider(10000, range=0..10000)

# ---- group: Find nodes of valency <3
pmconnvert = PmConnectedVertices(Polylines=line)
lng = ListLength(List=pmconnvert)  # -> flatten(Length)
smaller = SmallerThan(FirstNumber=lng, SecondNumber="3")  # -> SmallerThan, OrEqualTo

# ----
# Reset like Kangaroo
toggle = BooleanToggle(True)
# Enable timer
timer = Timer(TimerInterval=20, Target=dynamicmass)  # disabled
dynamicmass = DynamicMass(
    Nodes=pt,
    Springs=crv_2,
    Supports=pt_2,
    Stiffnesses=number_slider_2,
    NatLengths=len,
    MassDensity=num,
    MassType="0",
    Damping=0.95,
    Gravity=Slider(1.2, range=0..10),
    TimeStep=number_slider,
    Reset=toggle)  # -> Nodes, Valence, Masses, Bars, Forces, Iterations, Neighbours, Meshes
pmcomp = PmDecompose(Polylines=line)  # -> Vertices, Faces
preview = CustomPreview(
    Geometry=dynamicmass.Bars,
    Shader={ambient=RGB(0, 0, 0), diffuse=RGB(255, 105, 180), emission=RGB(76, 32, 54), shine=0.5, specular=RGB(255, 255, 255), transparency=0})
dispatch = Dispatch(List=flatten(pmcomp.Vertices), DispatchPattern=smaller.SmallerThan)  # -> ListA, ListB

# ---- group: Supports
msphereex = MeshSphereEx(Base=dispatch.ListA, Radius=Slider(0.1, range=0..0.1), Count=5)
preview_2 = CustomPreview(Geometry=msphereex, Shader=ColourSwatch(SwatchColor=RGB(0, 0, 0)))

# ---- group: Weak spring
number_slider_3 = Slider(20, range=0..100)

# ----
# Tweak graviational constant >>
number_slider_4 = Slider(0.01, range=0..0.01)
panel = Panel(dynamicmass.Forces)
# Reset like Kangaroo
toggle_2 = BooleanToggle(False)
# Enable timer
timer_2 = Timer(TimerInterval=20, Target=dynamicmass_2)  # disabled
dynamicmass_2 = DynamicMass(
    Nodes=pmcomp.Vertices,
    Springs=line,
    Supports=dispatch.ListA,
    Stiffnesses=number_slider_3,
    NatLengths=0,
    MassDensity=1,
    MassType="2",
    Damping=Slider(0.95, range=0..1),
    Gravity=Slider(1.2, range=-10..10),
    TimeStep=number_slider_4,
    Reset=toggle_2)  # -> Nodes, Valence, Masses, Bars, Forces, Iterations, Neighbours, Meshes
# Should match (approx.)
swatch = ColourSwatch(SwatchColor=RGBA(27, 169, 109, 82))

# ---- group: Area approximation used for area load
mesh = Mesh(dynamicmass_2.Meshes)

# ----
multiplication = Multiplication(A=dynamicmass_2.Masses, B="0.15")
multiplication_2 = Multiplication(A=dynamicmass_2.Masses, B="0.02")
preview_3 = CustomPreview(Geometry=mesh, Shader=swatch)

# ---- group: Show thrust network
preview_4 = CustomPreview(Geometry=dynamicmass_2.Bars, Shader=ColourSwatch(SwatchColor=RGB(64, 64, 64)))

# ----
Z = UnitZ(Factor=multiplication)
forces_n = Panel(dynamicmass_2.Forces)
vdisex = VectorDisplayEx(Point=dynamicmass_2.Nodes, Vector=Z, Colour=ColourSwatch(SwatchColor=RGB(124, 107, 255)), Width=2)
msphereex_2 = MeshSphereEx(Base=dynamicmass_2.Nodes, Radius=multiplication_2, Count="3")
area = MeshArea(Mesh=msphereex_2)  # -> Area, Centroid
bnd = Bounds(Numbers=area.Area)
dedomain = DeconstructDomain(Domain=bnd)  # -> Start, End
gradient = Gradient(LowerLimit=dedomain.Start, UpperLimit=dedomain.End, Parameter=area.Area, stops=[0: RGB(255, 255, 255), 1: RGB(0, 0, 0)])
# Visulise mass value
preview_5 = CustomPreview(Geometry=msphereex_2, Shader=gradient)
