# Grasshopper definition PearsonDualScript.gh (Grasshopper 0.9.76)
# plug-ins: Python Interpreter

crv = Curve(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)
crv_2 = Curve(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)
loft = Loft(Curves=[crv, crv_2], Options={Adjust=False, Closed=False, LoftEnds=0, LoftSimp=0, LoftType=0, Rebuild=10, Refit=0.01})
mesh_uv = MeshSurface(Surface=loft, UCount=Slider(5, range=0..100), VCount=Slider(16, range=0..100), Overhang=True, Equalize=False)
tri = Triangulate(Mesh=mesh_uv)  # -> Mesh, Count
# Visulise mass value
# Tweak graviational constant >>
# Reset like Kangaroo
# Enable timer
# Reset like Kangaroo
# Enable timer
python = PythonScript(mesh=tri.Mesh)  # -> out, a, b, c, d, e; inputs mesh: Mesh
# ---------- python: Python ----------
import System
plankton_dir = System.Environment.GetEnvironmentVariable("appdata")
plankton_dir += "\\Grasshopper\\Libraries\\"
import clr
clr.AddReferenceToFileAndPath(plankton_dir + "Plankton.dll")
import Plankton
clr.AddReferenceToFileAndPath(plankton_dir + "Plankton.gha")
import PlanktonGh.RhinoSupport as planktongh
from Rhino.Geometry import Line

def main():
    _mesh = planktongh.ToPlanktonMesh(mesh)
    
    _dual = dual(_mesh)
    
    a = planktongh.ToPolylines(_dual)
    b = clothededges(_dual)
    c = [planktongh.ToPoint3d(v) for v in _dual.Vertices]
    d = [c[i] for i in range(len(c)) if _dual.Vertices.IsBoundary(i)]
    
    # get vertex edge windings (wip)
    #vedges = []
    #for i in range(_dual.Vertices.Count):
    #    if (not _dual.Vertices.IsBoundary(i)):
    #        [h for h in _dual.Vertices.GetHalfedges(i)]
    #    else:
    #        vedges.append([])
    
    return a, b, c, d

def dual(mesh):
    # initialise the dual mesh
    dmesh = Plankton.PlanktonMesh()
    # add a dual vertex at the center of every primal face
    for i in range(mesh.Faces.Count):
        c = mesh.Faces.GetFaceCenter(i)
        dmesh.Vertices.Add(c.X, c.Y, c.Z)
    mplookup = []
    for i in range(0, mesh.Halfedges.Count, 2):
        if (mesh.Halfedges.IsBoundary(i)):
            mp = midpoint(mesh, i)
            n = dmesh.Vertices.Add(mp[0], mp[1], mp[2])
            mplookup += [n, n]
        else:
            mplookup += [-1, -1]
    # 
    
    for i in range(mesh.Vertices.Count):
        # create face for all "clothed" vertices
        if (not mesh.Vertices.IsBoundary(i)):
            vf = mesh.Vertices.GetVertexFaces(i)
            dmesh.Faces.AddFace(vf)
        # handle boundary vertices (special case)
        else:
            vf = [x for x in mesh.Vertices.GetVertexFaces(i) if x != -1]
            h = mesh.Vertices[i].OutgoingHalfedge
            vf += [mplookup[mesh.Halfedges[h].PrevHalfedge], mplookup[h]]
            #print vf, dmesh.Vertices.Count
            dmesh.Faces.AddFace(vf)
    return dmesh

def midpoint(mesh, i):
    hs = mesh.Halfedges
    x = 0.5 * (mesh.Vertices[hs[i].StartVertex].X + mesh.Vertices[hs.EndVertex(i)].X)
    y = 0.5 * (mesh.Vertices[hs[i].StartVertex].Y + mesh.Vertices[hs.EndVertex(i)].Y)
    z = 0.5 * (mesh.Vertices[hs[i].StartVertex].Z + mesh.Vertices[hs.EndVertex(i)].Z)
    return [x, y, z]

def clothededges(mesh):
    lines = []
    for i in range(0, mesh.Halfedges.Count, 2):
        if (not mesh.Halfedges.IsBoundary(i)):
            pt0 = mesh.Vertices[mesh.Halfedges[i].StartVertex]
            pt1 = mesh.Vertices[mesh.Halfedges.EndVertex(i)]
            lines.append(Line(pt0.X, pt0.Y, pt0.Z, pt1.X, pt1.Y, pt1.Z))
    return lines

import Rhino.Geometry as rg
from clr import AddReference as addr
addr("Grasshopper")

from clr import AddReference as addr
addr("Grasshopper")
from Grasshopper import DataTree
from Grasshopper.Kernel.Data import GH_Path

def raggedListToDataTree(raggedList):
    rl = raggedList
    result = DataTree[object]()
    for i in range(len(rl)):
        path = GH_Path(i)
        result.AddRange(rl[i], path)
    return result

if __name__ == "__main__":
    a, b, c, d = main()
# ---------- end python ----------
