# Grasshopper definition RectangularGrid.gh (Grasshopper 0.9.76)
# plug-ins: DynamicMass, Kangaroo Components, Starling

# ---- group: Rectangular
crv = Curve([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])
pt = Point([Point(-19.07521697, 12.90073041, 0), Point(-32.91839729, -0.1146093058, 0), Point(-37.09079983, -8.429776072, 0), Point(-19.82403096, -28.22269032, 0), Point(-4.153346126, -27.89032924, 0), Point(7.234402886, -22.83350349, 0), Point(2.450775627, -3.261029964, 0), Point(-11.6283835, 2.536084173, 0)])

# ---- group: Trivalent1
crv_2 = Curve([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])
pt_2 = Point([Point(22.74345157, 32.15015399, 0), Point(-8.590484895, 22.88265186, 0), Point(6.456470447, -4.154719237, 0), Point(28.55314166, -13.53836614, 0), Point(42.74690554, -0.862562126, 0)])

# ---- group: Rectangular - doesn't work
crv_3 = Curve([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])
pt_3 = Point([Point(-29, -124, 30), Point(-29, -137, 30), Point(-29, -150, 30), Point(-20, -163, -20), Point(-11, -163, -20), Point(-2, -163, -20), Point(7, -163, -20), Point(16, -163, -20), Point(25, -163, -20), Point(34, -163, -20), Point(43, -150, 30), Point(43, -137, 30), Point(43, -124, 30), Point(34, -111, -20), Point(25, -111, -20), Point(16, -111, -20), Point(7, -111, -20), Point(-2, -111, -20), Point(-11, -111, -20), Point(-20, -111, -20)])

# ---- group: Trivalent1
crv_4 = Curve([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])
pt_4 = Point([Point(-11.48790649, -33.85015527, 0), Point(-30.53477504, -47.99226935, 0), Point(-38.41440209, -72.65769375, 0), Point(-19.68655083, -87.38823022, 0), Point(16.18065893, -88.73612011, 0), Point(32.69450743, -66.17064295, 0), Point(31.7127046, -48.06522559, 0), Point(11.9093406, -33.89078057, 0)])

# ----
crv_5 = Curve([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])
pt_5 = Point([Point(-50, -192, 0), Point(-49, -232, 0), Point(-13, -245, 0), Point(8, -223, 0), Point(-5, -197, 0)])
crv_6 = Curve(crv_5)
# Tweak betwen Parabola (0) and Catenary (1) >>
pt_6 = Point(pt_5)
pmtrun = PmTruncate(Polylines=crv_3, Amount=0.585786)  # -> NewPolylines, PolylinesTruncated
end = EndPoints(Curve=crv_6)  # -> Start, End
number_slider = Slider(10, range=0..10)
number_slider_2 = Slider(0.005, range=0..0.01)
number_slider_3 = Slider(0.9, range=0..1)
number_slider_4 = Slider(0, range=0..2)
duppt = RemoveDuplicatePts(Points=[end.Start, end.End], Tolerance=0.01)
# Reset like Kangaroo
toggle = BooleanToggle(False)
# (Enable timer)
timer = Timer(TimerInterval=20, Target=dynamicmass)  # disabled
dynamicmass = DynamicMass(
    Nodes=duppt,
    Springs=crv_6,
    Supports=flatten(pt_6),
    Stiffnesses=Slider(0.5, range=0..10),
    NatLengths=0,
    MassDensity=number_slider,
    MassType=number_slider_4,
    Damping=number_slider_3,
    Gravity=9.81,
    TimeStep=number_slider_2,
    Reset=toggle)  # -> Nodes, Valence, Masses, Bars, Forces, Iterations, Neighbours, Meshes
number_slider_5 = Slider(1, range=0..1)
number_slider_6 = Slider(0.1, range=0..0.1)
len = Length(Curve=dynamicmass.Bars)
multiplication = Multiplication(A=dynamicmass.Masses, B="0.10")
preview = CustomPreview(Geometry=dynamicmass.Bars, Shader=ColourSwatch(SwatchColor=RGB(255, 255, 255)))
# (Enable timer)
timer_2 = Timer(TimerInterval=20, Target=dynamicmass_2)  # disabled
dynamicmass_2 = DynamicMass(
    Nodes=dynamicmass.Nodes,
    Springs=dynamicmass.Bars,
    Supports=flatten(pt_6),
    Stiffnesses=Slider(175, range=0..1000),
    NatLengths=len,
    MassDensity=number_slider,
    MassType=number_slider_4,
    Damping=number_slider_3,
    Gravity=9.81,
    TimeStep=number_slider_2,
    Reset=Toggle(False))  # -> Nodes, Valence, Masses, Bars, Forces, Iterations, Neighbours, Meshes
msphere = MeshSphere(Base=dynamicmass.Nodes, Radius=multiplication, UCount="6", VCount="6")
crv_7 = Curve(dynamicmass_2.Bars)
# Visulise mass value
preview_2 = CustomPreview(Geometry=msphere, Shader=ColourSwatch(SwatchColor=RGB(0, 126, 255)))
panel = Panel(dynamicmass.Forces)
panel_2 = Panel(dynamicmass_2.Forces)
division = Division(A=panel, B=panel_2)
bnd = Bounds(Numbers=division)
panel_3 = Panel(bnd)
