# Grasshopper definition example_002-3dFunicular.gh (Grasshopper 0.9.76)
# plug-ins: DynamicMass, Kangaroo Components

# Network
crv = Curve([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])
# Supports
pt = Point([Point(0.6566841006, 6.274390221, 9.610938157), Point(1.281350374, 10.75083542, 7.792681953), Point(1.397555113, 4.435307503, 10.19614174), Point(1.693510771, 13.03361702, 5.314161163), Point(1.785271645, 17.8139267, 4.12435262), Point(1.819808483, 2.605900764, 6.521268813)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])
# Tweak betwen Parabola (0) and Catenary (1) >>
preview = CustomPreview(Geometry=crv, Shader=ColourSwatch(SwatchColor=RGB(122, 122, 122)))
msphere = MeshSphere(Base=pt, Radius="0.25", UCount="6", VCount="6")
end = EndPoints(Curve=crv)  # -> Start, End
preview_2 = CustomPreview(Geometry=msphere, Shader=ColourSwatch(SwatchColor=RGB(0, 0, 0)))
duppt = RemoveDuplicatePts(Points=[end.Start, end.End], Tolerance=0.01)
# Reset like Kangaroo
toggle = BooleanToggle(True)
# (Enable timer)
timer = Timer(TimerInterval=20, Target=dynamicmass)  # disabled
dynamicmass = DynamicMass(
    Nodes=duppt,
    Springs=crv,
    Supports=flatten(pt),
    Stiffnesses=Slider(100, range=0..1000),
    NatLengths=0,
    MassDensity=1,
    MassType=Slider(1, range=0..2),
    Damping=Slider(0.9, range=0..1),
    Gravity=9.81,
    TimeStep=Slider(0.005, range=0..0.01),
    Reset=toggle)  # -> Nodes, Valence, Masses, Bars, Forces, Iterations, Neighbours, Meshes
preview_3 = CustomPreview(Geometry=dynamicmass.Bars, Shader=ColourSwatch(SwatchColor=RGB(255, 255, 255)))
multiplication = Multiplication(A=dynamicmass.Masses, B="0.10")
# Visulise mass value
panel = Panel("6")
msphere_2 = MeshSphere(Base=dynamicmass.Nodes, Radius=multiplication, UCount=panel, VCount=panel)
preview_4 = CustomPreview(Geometry=msphere_2, Shader=ColourSwatch(SwatchColor=RGB(0, 126, 255)))
