# Grasshopper definition example_003-3dAreaLoads.gh (Grasshopper 0.9.76)
# plug-ins: MeshEdit Components, Python Interpreter, DynamicMass, Starling

crv = Curve(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)
crv_2 = Curve(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)
loft = Loft(Curves=[crv, crv_2], Options={Adjust=False, Closed=False, LoftEnds=0, LoftSimp=0, LoftType=0, Rebuild=10, Refit=0.01})
mesh_uv = MeshSurface(Surface=loft, UCount=Slider(5, range=0..100), VCount=Slider(16, range=0..100), Overhang=True, Equalize=False)
tri = Triangulate(Mesh=mesh_uv)  # -> Mesh, Count
python = PythonScript(mesh=tri.Mesh)  # -> out, a, b, c, d, e; inputs mesh: Mesh
# ---------- python: Python ----------
import System
plankton_dir = System.Environment.GetEnvironmentVariable("appdata")
plankton_dir += "\\Grasshopper\\Libraries\\"
import clr
clr.AddReferenceToFileAndPath(plankton_dir + "Plankton.dll")
import Plankton
clr.AddReferenceToFileAndPath(plankton_dir + "Plankton.gha")
import PlanktonGh.RhinoSupport as planktongh
from Rhino.Geometry import Line

def main():
    _mesh = planktongh.ToPlanktonMesh(mesh)
    
    _dual = dual(_mesh)
    
    a = planktongh.ToPolylines(_dual)
    b = clothededges(_dual)
    c = [planktongh.ToPoint3d(v) for v in _dual.Vertices]
    d = [c[i] for i in range(len(c)) if _dual.Vertices.IsBoundary(i)]
    
    # get vertex edge windings (wip)
    #vedges = []
    #for i in range(_dual.Vertices.Count):
    #    if (not _dual.Vertices.IsBoundary(i)):
    #        [h for h in _dual.Vertices.GetHalfedges(i)]
    #    else:
    #        vedges.append([])
    
    return a, b, c, d

def dual(mesh):
    # initialise the dual mesh
    dmesh = Plankton.PlanktonMesh()
    # add a dual vertex at the center of every primal face
    for i in range(mesh.Faces.Count):
        c = mesh.Faces.GetFaceCenter(i)
        dmesh.Vertices.Add(c.X, c.Y, c.Z)
    mplookup = []
    for i in range(0, mesh.Halfedges.Count, 2):
        if (mesh.Halfedges.IsBoundary(i)):
            mp = midpoint(mesh, i)
            n = dmesh.Vertices.Add(mp[0], mp[1], mp[2])
            mplookup += [n, n]
        else:
            mplookup += [-1, -1]
    # 
    
    for i in range(mesh.Vertices.Count):
        # create face for all "clothed" vertices
        if (not mesh.Vertices.IsBoundary(i)):
            vf = mesh.Vertices.GetVertexFaces(i)
            dmesh.Faces.AddFace(vf)
        # handle boundary vertices (special case)
        else:
            vf = [x for x in mesh.Vertices.GetVertexFaces(i) if x != -1]
            h = mesh.Vertices[i].OutgoingHalfedge
            vf += [mplookup[mesh.Halfedges[h].PrevHalfedge], mplookup[h]]
            #print vf, dmesh.Vertices.Count
            dmesh.Faces.AddFace(vf)
    return dmesh

def midpoint(mesh, i):
    hs = mesh.Halfedges
    x = 0.5 * (mesh.Vertices[hs[i].StartVertex].X + mesh.Vertices[hs.EndVertex(i)].X)
    y = 0.5 * (mesh.Vertices[hs[i].StartVertex].Y + mesh.Vertices[hs.EndVertex(i)].Y)
    z = 0.5 * (mesh.Vertices[hs[i].StartVertex].Z + mesh.Vertices[hs.EndVertex(i)].Z)
    return [x, y, z]

def clothededges(mesh):
    lines = []
    for i in range(0, mesh.Halfedges.Count, 2):
        if (not mesh.Halfedges.IsBoundary(i)):
            pt0 = mesh.Vertices[mesh.Halfedges[i].StartVertex]
            pt1 = mesh.Vertices[mesh.Halfedges.EndVertex(i)]
            lines.append(Line(pt0.X, pt0.Y, pt0.Z, pt1.X, pt1.Y, pt1.Z))
    return lines

import Rhino.Geometry as rg
from clr import AddReference as addr
addr("Grasshopper")

from clr import AddReference as addr
addr("Grasshopper")
from Grasshopper import DataTree
from Grasshopper.Kernel.Data import GH_Path

def raggedListToDataTree(raggedList):
    rl = raggedList
    result = DataTree[object]()
    for i in range(len(rl)):
        path = GH_Path(i)
        result.AddRange(rl[i], path)
    return result

if __name__ == "__main__":
    a, b, c, d = main()
# ---------- end python ----------

# ---- group: Input curves
crv_3 = Curve(python.b)

# ----
line = Line(crv_3)

# ---- group: Find nodes of valency <3
pmconnvert = PmConnectedVertices(Polylines=line)
lng = ListLength(List=pmconnvert)  # -> flatten(Length)
smaller = SmallerThan(FirstNumber=lng, SecondNumber="3")  # -> SmallerThan, OrEqualTo

# ---- group: Scale the masses
number_slider = Slider(0.01, range=0..0.01)
num = Number([0, 8.270017438, 0, 8.736893596, 0, 5.687620388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])
multiplication = Multiplication(A=num, B=Slider(0.02, range=0..0.1))

# ----
pmcomp = PmDecompose(Polylines=line)  # -> Vertices, Faces
crv_4 = Curve([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])
dispatch = Dispatch(List=flatten(pmcomp.Vertices), DispatchPattern=smaller.SmallerThan)  # -> ListA, ListB

# ---- group: Supports
msphere = MeshSphere(Base=dispatch.ListA, Radius=Slider(0.1, range=0..0.1), UCount=10, VCount=20)
preview = CustomPreview(Geometry=msphere, Shader=ColourSwatch(SwatchColor=RGB(255, 0, 0)))

# ---- group: Random spring stiffnesses
lng_2 = ListLength(List=line)
# Tweak graviational constant >>
random = Random(Range=Domain(10, 20), Number=lng_2, Seed="4")

# ----
number_slider_2 = Slider(0.0001, range=0..0.001)
len = Length(Curve=crv_4)
pt = Point([Point(-3.828283787, 5.745425224, 2), Point(-2.977893353, 10.17921448, 2), Point(-2.591150045, 1.36666584, 2), Point(0.2813107371, -2.454623222, 2), Point(1.703722954, 14.7683754, 2), Point(5.521384716, 7.866375923, 0)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])
pt_2 = Point([Point(-3.828283787, 5.745425224, 2), Point(-1.099136472, 6.933872312, 3.105804808), Point(-2.977893353, 10.17921448, 2), Point(-0.6360197793, 9.047835694, 3.118385009), Point(-2.591150045, 1.36666584, 2), Point(1.166956295, 6.008521344, 3.702934189)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])
timer = Timer(TimerInterval=20, Target=dynamicmass)  # disabled
# Reset like Kangaroo
toggle = BooleanToggle(False)
dynamicmass = DynamicMass(
    Nodes=pt_2,
    Springs=crv_4,
    Supports=pt,
    Stiffnesses=Slider(10000, range=0..10000),
    NatLengths=len,
    MassDensity=num,
    MassType="0",
    Damping=0.95,
    Gravity=Slider(1.2, range=0..10),
    TimeStep=Slider(1e-05, range=0..1e-05),
    Reset=Toggle(False))  # -> Nodes, Valence, Masses, Bars, Forces, Iterations, Neighbours, Meshes
# Enable timer
timer_2 = Timer(TimerInterval=20, Target=dynamicmass_2)  # disabled
dynamicmass_2 = DynamicMass(
    Nodes=pmcomp.Vertices,
    Springs=line,
    Supports=dispatch.ListA,
    Stiffnesses=Slider(20, range=0..100),
    NatLengths=0,
    MassDensity=1,
    MassType="2",
    Damping=Slider(0.95, range=0..1),
    Gravity=Slider(1.2, range=-10..10),
    TimeStep=Slider(0.01, range=0..0.01),
    Reset=toggle)  # -> Nodes, Valence, Masses, Bars, Forces, Iterations, Neighbours, Meshes
preview_2 = CustomPreview(
    Geometry=dynamicmass.Bars,
    Shader={ambient=RGB(0, 0, 0), diffuse=RGB(255, 105, 180), emission=RGB(76, 32, 54), shine=0.5, specular=RGB(255, 255, 255), transparency=0})
panel = Panel(dynamicmass.Forces)

# ---- group: Area approximation used for area load
mesh = Mesh(dynamicmass_2.Meshes)

# ----
multiplication_2 = Multiplication(A=dynamicmass_2.Masses, B="0.02")
# Visulise mass value
preview_3 = CustomPreview(Geometry=dynamicmass_2.Bars, Shader=ColourSwatch(SwatchColor=RGB(64, 64, 64)))
preview_4 = CustomPreview(Geometry=mesh, Shader=ColourSwatch(SwatchColor=RGBA(27, 169, 109, 82)))
panel_2 = Panel(dynamicmass_2.Forces)
msphereex = MeshSphereEx(Base=dynamicmass_2.Nodes, Radius=multiplication_2, Count="3")
area = MeshArea(Mesh=msphereex)  # -> Area, Centroid
bnd = Bounds(Numbers=area.Area)
dedomain = DeconstructDomain(Domain=bnd)  # -> Start, End
gradient = Gradient(LowerLimit=dedomain.Start, UpperLimit=dedomain.End, Parameter=area.Area, stops=[0: RGB(255, 255, 255), 1: RGB(0, 0, 0)])
preview_5 = CustomPreview(Geometry=msphereex, Shader=gradient)
